# Grasshopper definition Maile_skript_RV4bt3A.gh (Grasshopper 1.0.8)

construct_point = ConstructPoint(XCoordinate="100", YCoordinate="100", ZCoordinate=0)
construct_point_2 = ConstructPoint(XCoordinate=0, YCoordinate=0, ZCoordinate=0)
square = Square(Plane=PlaneXY(0, 0, 0), Size=1, ExtentX="100", ExtentY="100")  # -> Cells, flatten(Points)
rectangle_2pt = Rectangle2Pt(Plane=PlaneXY(0, 0, 0), PointA=construct_point_2, PointB=Point(10, 5, 0), Radius=0)  # -> Rectangle, Length
image_sampler = ImageSampler(
    square.Points,
    FilePath="C:\Users\danie\Desktop\Maile habhbio.png",
    Filter="Colour",
    Interpolate=False,
    Umax=100,
    Umin=1,
    Vmax=100,
    Vmin=1,
    Wrap=1)
number = Number(image_sampler)
division = Division(A=number, B="4")
center_box = CenterBox(Base=square.Points, X=division, Y=division, Z="0")
custom_preview = CustomPreview(Geometry=center_box, Material=ColourSwatch(SwatchColor=RGB(0, 0, 0)))
populate_2d = Populate2D(Region=center_box, Count="10", Seed=1)
