# Grasshopper definition screw_array_danzer.gh (Grasshopper 1.0.8)
# plug-ins: Pufferfish, Human

# ---- group: Schritt 1: Reference Curves einlesen / If surface isnt Valid flip one curve in Rhino
switch_order_flip_plane = BooleanToggle(False)

# ---- group: Schritt 1: Reference Curves einlesen / Wenn frames schräg sind try this
all_frames_middle_angle = BooleanToggle(False)

# ---- group: Schritt 1: Reference Curves einlesen / Curve 2
curve = Curve(<curve referenced from the Rhino model>)

# ---- group: Schritt 1: Reference Curves einlesen / Curve 1
curve_2 = Curve(<curve referenced from the Rhino model>)

# ---- group: Schritt 2: Bohrmuster Definieren + Verschieben
unterteilungsmaß_der_bohrungen_schrauben = Panel("900")

# ---- group: Schritt 2: Bohrmuster Definieren + Verschieben / Äußerste Bohrungen für ...mm entfernen?
remove_outer_holes = Slider(0, range=0..500)

# ---- group: Schritt 2: Bohrmuster Definieren + Verschieben / Offset Innen/Außen
distance = Slider(18, range=0..30)
flip_direction = BooleanToggle(True)

# ---- group: Schritt 2: Bohrmuster Definieren + Verschieben / Offset Oben/Unten von Mitte
distance_2 = Slider(2.5, range=0..100)
flip_direction_2 = BooleanToggle(False)

# ---- group: Schritt 2: Bohrmuster Definieren + Verschieben / Offset Links/Rechts von Mitte
distance_3 = Slider(0, range=0..100)
flip_direction_3 = BooleanToggle(False)

# ---- group: Schritt 3: Bohrloch/Block Konfigurieren / Tiefe der Bohrung
tiefe_loch = Panel("-15")

# ---- group: Schritt 3: Bohrloch/Block Konfigurieren / Konfiguration Typ 0: Rundloch
rundloch_durchmesser = Panel("11")

# ---- group: Schritt 3: Bohrloch/Block Konfigurieren / Konfiguration Typ 1: Langloch
dimension_1 = Slider(33.1, range=0..100)
dimension_2_durchm = Slider(6.9, range=0..100)
flip_90 = BooleanToggle(True)

# ---- group: Schritt 3: Bohrloch/Block Konfigurieren / Konfiguration Typ 2: Senkkopf (45°)
duchgang_diameter = Slider(4.134, range=0..20)
bohrkegel_radius = Slider(5.1, range=0..20)

# ---- group: Schritt 3: Bohrloch/Block Konfigurieren / Optional: custom insert point
point = Point(Point(0, 0, 0))
panel = Panel(point)

# ---- group: Schritt 3: Bohrloch/Block Konfigurieren / Typ 3: Block Array / Block 1
geometry = Geometry(<instancereference referenced from the Rhino model>)

# ---- group: Block 2
geometry_2 = Geometry(<extrusion referenced from the Rhino model>)

# ---- group: Schritt 3: Bohrloch/Block Konfigurieren / Typ 3: Block Array / Block 2
geometry_3 = Geometry(<extrusion referenced from the Rhino model>)

# ---- group: Block 2
geometry_4 = Geometry(<extrusion referenced from the Rhino model>)

# ---- group: Schritt 4: Lochtyp Auswählen / Lochtyp Auswählen
# Rund      Lang      Senk      Block
select_hole_type = Slider(3, range=0..3)

# ---- group: Schritt 5: Bake! / Knopf für autmatisches Baking - einzeln
bake = Button()

# ----
curve_3 = Curve(curve_2)
curve_4 = Curve(curve)
curve_middle = CurveMiddle(Curve=curve_3)
curve_closest_point = CurveClosestPoint(Point=curve_middle, Curve=curve_4)  # -> Point, Parameter, Distance
line = Line(StartPoint=curve_middle, EndPoint=curve_closest_point.Point)
move = Move(Geometry=curve_3, Motion=line)  # -> Geometry, Transform
stream_filter = StreamFilter(Gate=all_frames_middle_angle, Stream0=curve_4, Stream1=move.Geometry)

# ---- group: Find 0,0,0
point_2 = Point(Point(0, 10000, 0))
point_3 = Point(Point(0, 0, 0))
line_2 = Line(StartPoint=point_3, EndPoint=point_2)
yz_plane = YZPlane(Origin=Point(0, 0, 0))
text_on_surface = TextOnSurface(
    Text=". <--- insert Blocks here: at Point 0,0,0",
    Font="Sans Bold:no Italic:no",
    Height="1000",
    Depth=0.4,
    BaseLine=line_2,
    BaseSurface=yz_plane)
rotate = Rotate(Geometry=text_on_surface, Angle=degrees("180"), Plane=yz_plane)  # -> Geometry, Transform

# ----
negative = Negative(Value=tiefe_loch)
createattributes = CreateAttributes(LayerName="3D", enableFullPath=False)
panel_2 = Panel(tiefe_loch)

negative_2 = Negative(Value=distance_2)
stream_filter_2 = StreamFilter(Gate=flip_direction_2, Stream0=distance_2, Stream1=negative_2)
panel_3 = Panel(stream_filter_2)

negative_3 = Negative(Value=distance_3)
stream_filter_3 = StreamFilter(Gate=flip_direction_3, Stream0=distance_3, Stream1=negative_3)
panel_4 = Panel(stream_filter_3)

division = Division(A=tiefe_loch, B=-10)
multiplication = Multiplication(A=tiefe_loch, B=1.1)
division_2 = Division(A=tiefe_loch, B="10")
xy_plane = XYPlane(Origin=Point(0, 0, 0))

stream_filter_4 = StreamFilter(Gate=switch_order_flip_plane, Stream0=curve_3, Stream1=stream_filter)
stream_filter_5 = StreamFilter(Gate=switch_order_flip_plane, Stream0=stream_filter, Stream1=curve_3)
flip_curve = FlipCurve(Curve=stream_filter_4)  # -> Curve, Flag
flip_curve_2 = FlipCurve(Curve=stream_filter_5)  # -> Curve, Flag
curve_5 = Curve(flip_curve.Curve)
curve_6 = Curve(flip_curve_2.Curve)
negative_4 = Negative(Value=distance)
stream_filter_6 = StreamFilter(Gate=flip_direction, Stream0=distance, Stream1=negative_4)
division_3 = Division(A=rundloch_durchmesser, B=2)
division_4 = Division(A=dimension_1, B=2)
division_5 = Division(A=dimension_2_durchm, B=2)
concatenate = Concatenate(B="-", Fragment_A=division_5, Fragment_B=" to ", A=division_5)
concatenate_2 = Concatenate(B="-", Fragment_A=division_4, Fragment_B=" to ", A=division_4)
panel_5 = Panel(division_5)
stream_filter_7 = StreamFilter(Gate=flip_90, Stream0=concatenate, Stream1=concatenate_2)
stream_filter_8 = StreamFilter(Gate=flip_90, Stream0=concatenate_2, Stream1=concatenate)
panel_6 = Panel(stream_filter_8)
panel_7 = Panel(stream_filter_7)

loft = Loft(
    Curves=[curve_5, curve_6],
    Options={Adjust=False, Closed=False, LoftEnds=0, LoftSimp=0, LoftType=3, Rebuild=10, Refit=0.01})
subtraction = Subtraction(B=200)
average_curve = AverageCurve(Curves=[curve_5, curve_6], Refit=3, PointSample=0)
length = Length(Curve=average_curve)
panel_8 = Panel(length)
offset_surface = OffsetSurface(Surface=loft, Distance=subtraction, Retrim=True)
subtraction_2 = Subtraction(A=panel_8, B=remove_outer_holes)
division_6 = Division(A=subtraction_2, B=unterteilungsmaß_der_bohrungen_schrauben)
round = Round(Number=division_6)  # -> Nearest, Floor, Ceiling
multiplication_2 = Multiplication(A=round.Floor, B=unterteilungsmaß_der_bohrungen_schrauben)
subtraction_3 = Subtraction(A=panel_8, B=multiplication_2)
division_7 = Division(A=subtraction_3, B=2)
negative_5 = Negative(Value=division_7)
panel_9 = Panel(negative_5)
extend_curve = ExtendCurve(Curve=average_curve, Type="1", Start=panel_9, End=panel_9)
divide_length = DivideLength(Curve=extend_curve, Length=unterteilungsmaß_der_bohrungen_schrauben)  # -> flatten(Points), Tangents, Parameters
curve_closest_point_2 = CurveClosestPoint(Point=divide_length.Points, Curve=extend_curve)  # -> Point, Parameter, Distance
evaluate_curve = EvaluateCurve(Curve=extend_curve, Parameter=curve_closest_point_2.Parameter)  # -> Point, flatten(Tangent), Angle
amplitude = Amplitude(Vector=evaluate_curve.Tangent, Amplitude=stream_filter_3)
move_2 = Move(Geometry=divide_length.Points, Motion=amplitude)  # -> Geometry, Transform
surface_closest_point = SurfaceClosestPoint(Point=move_2.Geometry, Surface=offset_surface)  # -> Point, UVPoint, Distance
evaluate_surface = EvaluateSurface(Surface=loft, Point=surface_closest_point.UVPoint)  # -> Point, Normal, UDirection, VDirection, flatten(Frame)

panel_10 = Panel(division)
deconstruct_plane = DeconstructPlane(Plane=evaluate_surface.Frame)  # -> Origin, XAxis, YAxis, ZAxis
amplitude_2 = Amplitude(Vector=deconstruct_plane.ZAxis, Amplitude=panel_10)
panel_11 = Panel(multiplication)
plane = Plane(evaluate_surface.Frame)
amplitude_3 = Amplitude(Vector=deconstruct_plane.XAxis, Amplitude=stream_filter_2)
amplitude_4 = Amplitude(Vector=deconstruct_plane.ZAxis, Amplitude=panel_11)
reverse = Reverse(Vector=amplitude_3)
move_3 = Move(Geometry=plane, Motion=reverse)  # -> Geometry, Transform
cylinder = Cylinder(Base=move_3.Geometry, Radius=division_3, Length=multiplication)
orient = Orient(Geometry=geometry, Source=point, Target=graft(move_3.Geometry))  # -> Geometry, Transform
move_4 = Move(Geometry=cylinder, Motion=amplitude_2)  # -> Geometry, Transform
cap_holes = CapHoles(Brep=move_4.Geometry)

# ---- group: Schritt 4: Lochtyp Auswählen / Rundloch
geometry_5 = Geometry(flatten(cap_holes))

# ---- group: Schritt 4: Lochtyp Auswählen / Custom
geometry_6 = Geometry(flatten(orient.Geometry))

# ---- group: senkkopf
point_4 = Point(panel)
circle = Circle(Plane=point_4, Radius=bohrkegel_radius)
circle_2 = Circle(Plane=point_4, Radius="0.001")
negative_6 = Negative(Value=bohrkegel_radius)
panel_12 = Panel(panel_10)
unit_z = UnitZ(Factor=panel_12)
unit_z_2 = UnitZ(Factor=negative_6)
division_8 = Division(A=duchgang_diameter, B=2)
move_5 = Move(Geometry=circle_2, Motion=unit_z_2)  # -> Geometry, Transform
extrude = Extrude(Base=circle, Direction=unit_z)
loft_2 = Loft(
    Curves=[circle, move_5.Geometry],
    Options={Adjust=False, Closed=False, LoftEnds=0, LoftSimp=0, LoftType=0, Rebuild=10, Refit=0.01})
amplitude_5 = Amplitude(Vector=unit_z_2, Amplitude=negative)
circle_3 = Circle(Plane=point_4, Radius=division_8)
cap_holes_2 = CapHoles(Brep=loft_2)
cap_holes_3 = CapHoles(Brep=extrude)
extrude_2 = Extrude(Base=circle_3, Direction=amplitude_5)
cap_holes_4 = CapHoles(Brep=extrude_2)
solid_union = SolidUnion(Breps=[cap_holes_3, cap_holes_2, cap_holes_4])
orient_2 = Orient(Geometry=solid_union, Source=point, Target=graft(move_3.Geometry))  # -> Geometry, Transform

# ---- group: Schritt 4: Lochtyp Auswählen / Senkkopf
geometry_7 = Geometry(flatten(orient_2.Geometry))

# ----
panel_13 = Panel(length)
amplitude_6 = Amplitude(Vector=deconstruct_plane.ZAxis, Amplitude=stream_filter_6)
plane_2 = Plane(move_3.Geometry)

multiplication_3 = Multiplication(A=panel_10, B=2)

# ---- group: Position arrow
unit_z_3 = UnitZ(Factor="9")
point_5 = Point(panel)
move_6 = Move(Geometry=point_5, Motion=unit_z_3)  # -> Geometry, Transform
unit_z_4 = UnitZ(Factor="20")
circle_4 = Circle(Plane=move_6.Geometry, Radius="3")
circle_5 = Circle(Plane=point_5, Radius="0.001")
circle_6 = Circle(Plane=move_6.Geometry, Radius="1.2")
loft_3 = Loft(
    Curves=[circle_4, circle_5],
    Options={Adjust=False, Closed=False, LoftEnds=0, LoftSimp=0, LoftType=0, Rebuild=10, Refit=0.01})
extrude_3 = Extrude(Base=circle_6, Direction=unit_z_4)
cap_holes_5 = CapHoles(Brep=extrude_3)
cap_holes_6 = CapHoles(Brep=loft_3)
panel_14 = Panel(multiplication_3)
unit_z_5 = UnitZ(Factor=panel_14)
group = Group(Objects=[cap_holes_5, cap_holes_6])
move_7 = Move(Geometry=group, Motion=unit_z_5)  # -> Geometry, Transform

# ----
move_8 = Move(Geometry=plane_2, Motion=amplitude_6)  # -> Geometry, Transform
orient_3 = Orient(Geometry=move_7.Geometry, Source=PlaneXY(0, 0, 0), Target=plane_2)  # -> Geometry, Transform
orient_4 = Orient(Geometry=move_7.Geometry, Source=PlaneXY(0, 0, 0), Target=xy_plane)  # -> Geometry, Transform

# ---- group: Preview on
geo = Geometry(solid_union)
srf = Surface(loft)
geometry_8 = Geometry([orient_3.Geometry, orient_4.Geometry])
point_6 = Point(divide_length.Points)
plane_3 = Plane(move_8.Geometry)

# ---- group: Langlöcher
rectangle = Rectangle(Plane=move_3.Geometry, XSize=panel_6, YSize=panel_7, Radius=division_5)  # -> Rectangle, Length
panel_15 = Panel(division_2)
extrude_4 = Extrude(Base=rectangle.Rectangle, Direction=amplitude_4)

# ----
negative_7 = Negative(Value=panel_15)
cap_holes_7 = CapHoles(Brep=extrude_4)

# ---- group: Langlöcher (continued)
amplitude_7 = Amplitude(Vector=deconstruct_plane.ZAxis, Amplitude=negative_7)
move_9 = Move(Geometry=cap_holes_7, Motion=amplitude_7)  # -> Geometry, Transform
geometry_9 = Geometry(move_9.Geometry)

# ---- group: Schritt 4: Lochtyp Auswählen / Langloch
geometry_10 = Geometry(flatten(geometry_9))

# ----
stream_filter_9 = StreamFilter(Gate=select_hole_type, Stream0=geometry_5, Stream1=geometry_10, Stream2=geometry_7, Stream3=geometry_6)
geometry_11 = Geometry(stream_filter_9)
move_10 = Move(Geometry=geometry_11, Motion=amplitude_6)  # -> Geometry, Transform

# ---- group: Schritt 5: Bake! / Oder nmanuelles Baking - Gruppieren möglich
geometry_12 = Geometry(move_10.Geometry)

# ---- group: Wenn Liste mehrere Ebenen hat, dann Error!
kontrolle_keine_doppelten_listen = Panel(geometry_12)

# ----
bake_geometry = BakeGeometry(Bake=bake, Geometry=move_10.Geometry, Attributes=createattributes, DeleteOldBakes=False, PreserveTrees=False)
